% Simulink data dictionary simulation_interfaces.sldd

V2X_Vehicle_Sim = Simulink.Bus()
  x_m: double
  y_m: double
  psi_rad: double
  vx_mps: double
  vy_mps: double
  dPsi_radps: double

Chassis = Simulink.Bus()
  r_I_Chassis_m: double[3 1]
  v_I_Chassis_mps: double[3 1]
  a_I_Chassis_mps2: double[3 1]
  phi_I_Chassis_rad: double[3 1]
  omega_I_Chassis_radps: double[3 1]
  alpha_I_Chassis_radps2: double[3 1]
  v_C_Chassis_mps: double[3 1]
  a_C_Chassis_mps2: double[3 1]
  omega_C_Chassis_radps: double[3 1]
  alpha_C_Chassis_radps2: double[3 1]

Transformation = Simulink.Bus()
  rotmatrix_I2V: double[3 3]
  rotmatrix_C2V: double[3 3]
  rotmatrix_I2C: double[3 3]
  rotmatrix_C2WFL: double[3 3]
  rotmatrix_C2WFR: double[3 3]
  rotmatrix_OrientationChange: double[3 3]

Force = Simulink.Bus()
  F_V_Vehicle_N: double[3 1]
  T_V_Vehicle_Nm: double[3 1]
  F_V_Drag_N: double[3 1]
  T_V_Drag_Nm: double[3 1]
  F_V_Gravity_N: double[3 1]
  F_V_Hardpoints_N: double[3 4]
  T_V_Hardpoints_Nm: double[3 4]
  F_C_Hardpoints_N: double[3 4]
  T_C_Hardpoints_Nm: double[3 4]
  F_C_Tires_N: double[3 4]
  T_C_Tires_Nm: double[3 4]
  F_T_Tires_N: double[3 4]
  T_T_Tires_Nm: double[3 4]

Sensor = Simulink.Bus()
  r_I_VehicleSensor1_m: double[3 1]
  r_I_VehicleSensor2_m: double[3 1]
  r_I_VehicleSensor3_m: double[3 1]
  rotmatrix_I2VehicleSensor1: double[3 3]
  rotmatrix_I2VehicleSensor2: double[3 3]
  rotmatrix_I2VehicleSensor3: double[3 3]

SimInformation = Simulink.Bus()
  Vehicle: Bus: Vehicle
  Chassis: Bus: Chassis
  Suspension: Bus: Suspension
  Wheel: Bus: Wheel
  Sensor: Bus: Sensor
  Transformation: Bus: Transformation
  Force: Bus: Force

Vehicle = Simulink.Bus()
  r_I_Vehicle_m: double[3 1]
  v_I_Vehicle_mps: double[3 1]
  a_I_Vehicle_mps2: double[3 1]
  phi_I_Vehicle_rad: double[3 1]
  omega_I_Vehicle_radps: double[3 1]
  alpha_I_Vehicle_radps2: double[3 1]
  v_V_Vehicle_mps: double[3 1]
  a_V_Vehicle_mps2: double[3 1]
  omega_V_Vehicle_radps: double[3 1]
  alpha_V_Vehicle_radps2: double[3 1]
  r_I_Hardpoints_m: double[3 4]
  v_I_Hardpoints_mps: double[3 4]
  r_V_Cog2Hardpoints_m: double[3 4]
  v_V_Hardpoints_mps: double[3 4]

Wheel = Simulink.Bus()
  r_I_Wheels_m: double[3 4]
  v_C_Wheels_mps: double[3 4]
  re_WheelsEffective_m: double[1 4]
  omegay_W_Wheels_rad: double[1 4]
  r_I_Tires_m: double[3 4]
  kappa_Tires: double[1 4]
  alpha_Tires_rad: double[1 4]

Suspension = Simulink.Bus()
  h_Suspensions_m: double[1 4]
  wheelangles_rad: double[3 4]

BrakePressure_Pa = Simulink.Bus()
  p_BrakePressureFL_pa: double
  p_BrakePressureFR_pa: double
  p_BrakePressureRL_pa: double
  p_BrakePressureRR_pa: double

DriveTorque_Nm = Simulink.Bus()
  T_DriveTorqueFL_Nm: double, Unit="N"
  T_DriveTorqueFR_Nm: double, Unit="N"
  T_DriveTorqueRL_Nm: double, Unit="N"
  T_DriveTorqueRR_Nm: double, Unit="N"

SimRealState = Simulink.Bus()
  x_m: double
  y_m: double
  z_m: double
  phi_rad: double
  theta_rad: double
  psi_rad: double
  vx_mps: double
  vy_mps: double
  vz_mps: double
  dPhi_radps: double
  dTheta_radps: double
  dPsi_radps: double
  ax_mps2: double
  ay_mps2: double
  az_mps2: double
  nWheelFL_radps: double
  nWheelFR_radps: double
  nWheelRL_radps: double
  nWheelRR_radps: double
  DeltaWheel_rad: double
  dnWheelFL_radps2: double
  dnWheelFR_radps2: double
  dnWheelRL_radps2: double
  dnWheelRR_radps2: double

VehicleParameterSet = Simulink.Bus()
  cLiftF: double
  cLiftR: double
  CoGx_m: double
  CoGy_m: double
  CoGz_m: double
  cDrag: double
  Aref_m2: double
  Gearratio: double
  Wheelbase_m: double
  PacLatF: double[5]
  PacLongF: double[5]
  PacLatR: double[5]
  PacLongR: double[5]
  cRollFriction_Npmps: double
  MaxRollFriction_N: double
  T_YawRate_s: double
  T_LatVel_s: double
  TrackWidthF_m: double
  TrackWidthR_m: double
  TireRadiusF_m: double
  TireRadiusR_m: double
  VehicleInertia_kgm2: double
  WheelInertiaF_kgm2: double
  WheelInertiaR_kgm2: double
  VehicleMass_kg: double
  switchModelBlend_mps: double
  PTLimitLowVel_N: double
  switchModelVel_mps: double
  T_Tire_s: double