% Simulink data dictionary pa_sim_vehicleparameter.sldd

veh_param_db = struct(
  cLiftF=1,
  cLiftR=2.1,
  CoGx_m=1.4,
  CoGy_m=0,
  CoGz_m=0.4,
  cDrag=2.3,
  Aref_m2=1,
  Gearratio=4,
  Wheelbase_m=3.4,
  PacLatF=[5 2.35 5000 1 3000],
  PacLongF=[4.7 2 10000 1 3000],
  PacLatR=[5 2.35 5000 1 3000],
  PacLongR=[4.7 2 10000 1 3000],
  cRollFriction_Npmps=200,
  MaxRollFriction_N=200,
  T_YawRate_s=0.15,
  T_LatVel_s=0.15,
  TrackWidthF_m=1.7,
  TrackWidthR_m=1.7,
  TireRadiusF_m=0.42,
  TireRadiusR_m=0.42,
  VehicleInertia_kgm2=1500,
  WheelInertiaF_kgm2=2,
  WheelInertiaR_kgm2=2,
  VehicleMass_kg=1300,
  switchModelBlend_mps=0.5,
  PTLimitLowVel_N=-500,
  switchModelVel_mps=3,
  T_Tire_s=0.02)