% Simulink data dictionary racetrack.sldd

Racetrack = struct(
  ValidPointCnt=3,
  x_ref_m=[-304.6384835; -304.5866582; -304.5348487; 0; 0; 0; 0; 0; 0; 0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 0],
  y_ref_m=[-1792.3996756; -1795.3972816; -1798.3948885; 0; 0; 0; 0; 0; 0; 0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 0],
  width_right_m=[7.0803322; 7.0725669; 7.0590218; 0; 0; 0; 0; 0; 0; 0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 0],
  width_left_m=[7.0196678; 7.0275828; 7.0411285; 0; 0; 0; 0; 0; 0; 0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 0],
  x_normvec_m=[-0.9998505; -0.9998506; -0.9998507; 0; 0; 0; 0; 0; 0; 0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 0],
  y_normvec_m=[-0.0172891; -0.0172836; -0.0172786; 0; 0; 0; 0; 0; 0; 0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 0],
  psi_racetraj_rad=[-3.1243513; -3.1243546; -3.1243609; 0; 0; 0; 0; 0; 0; 0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 0],
  bankingangle_rad=repmat(0, 5000, 1))

activate_TrackProfile = 0
current_racetrack = "traj_ltpl_cl_example.csv"